# Dynamo graph dam.dyn (Dynamo 2.5.2.7915)

# group: Input
level_hrv_is_dfv_mfv = StringInput("HRV + is")  # graph input
excel_data_directory_path = Directory("C:\Users\tims\OneDrive - Multiconsult\Python\JupyterNotebooks\Damstabilitet2\export")  # graph input
property_set_egenskaper = Filename(".\Egenskaper.json")  # graph input
property_set_stabilitet = Filename(".\Stabilitet.json")  # graph input

dam_stability_3d = Custom[dam_stability_3d](Vannstand=level_hrv_is_dfv_mfv, Directory=excel_data_directory_path, EgenskaperDir=property_set_egenskaper, StabilitetDir=property_set_stabilitet)
