# Dynamo custom node dam_stability_3d.dyf (Dynamo 2.5.2.7915)
# category: dam_stability

# group: Input
Directory = Input(Directory: string)
Vannstand = Input(Vannstand: string)
EgenskaperDir = Input(EgenskaperDir: string)
StabilitetDir = Input(StabilitetDir: string)

# group: File Paths
geometries = Python(IN[0]=Directory, IN[1]=Vannstand)
# ---------- geometries.python (5 lines) ----------
def path(string):
	return IN[0] + '\\' + IN[1] + '_' + string + '.xlsx'


OUT = [path('data'), path('x'), path('y')]
# ----------------------------------------
code_block = CodeBlock(l=geometries) { List.GetItemAtIndex(l, 0); List.GetItemAtIndex(l, 1); List.GetItemAtIndex(l, 2); }
evaluation = Python(IN[0]=Directory)
# ---------- evaluation.python (1 lines) ----------
OUT = IN[0] + '\\evaluation.xlsx'
# ----------------------------------------

# group: Import
file_from_path = FileObject(path=code_block.out0)
code_block_2 = CodeBlock { "Sheet1"; }
boolean = BoolSelector(false)
importExcel = Data.ImportExcel(file=file_from_path, sheetName=code_block_2, readAsStrings=boolean, showExcel=boolean)
clean = List.Clean(list=importExcel)
file_from_path_2 = FileObject(path=code_block.out1)
importExcel_2 = Data.ImportExcel(file=file_from_path_2, sheetName=code_block_2, readAsStrings=boolean, showExcel=boolean)
clean_2 = List.Clean(list=importExcel_2)
file_from_path_3 = FileObject(path=code_block.out2)
importExcel_3 = Data.ImportExcel(file=file_from_path_3, sheetName=code_block_2, readAsStrings=boolean, showExcel=boolean)
clean_3 = List.Clean(list=importExcel_3)
file_from_path_4 = FileObject(path=evaluation)
importExcel_4 = Data.ImportExcel(file=file_from_path_4, sheetName=code_block_2, readAsStrings=boolean, showExcel=boolean)

# group: Create Volumes
code_block_3 = CodeBlock { 1; 3; }
getItemAtIndex = List.GetItemAtIndex(list=clean@L2, index=code_block_3.out0)
remove_last = Python(IN[0]=clean_2)
# ---------- remove_last.python (1 lines) ----------
OUT = [i[:-1] for i in IN[0]]
# ----------------------------------------
remove_last_2 = Python(IN[0]=clean_3)  # same code as remove_last
byCoordinates = Point.ByCoordinates(x=getItemAtIndex, y=remove_last, z=remove_last_2)
byPoints = Polygon.ByPoints(points=byCoordinates)
byPatch = Surface.ByPatch(closedCurve=byPoints)
getItemAtIndex_2 = List.GetItemAtIndex(list=clean@L2, index=code_block_3.out1)
thicken = Surface.Thicken(surface=byPatch, thickness=getItemAtIndex_2)

# group: Attributes
code_block_4 = CodeBlock(l=clean) { List.GetItemAtIndex(l<2>, 0); List.GetItemAtIndex(l<2>, 2); List.GetItemAtIndex(l<2>, 3); }
volume = Solid.Volume(solid=thicken)
code_block_5 = CodeBlock(l=volume) { Math.Round(l, 4); }
load = code_block_5 * code_block_4.out1

# group: Sections To Civil 3D Model Space
layer_names = Python(IN[0]=code_block_4.out0, IN[1]=Vannstand)
# ---------- layer_names.python (3 lines) ----------
import re

OUT = [IN[1] + '_Pilar ' + re.findall(r'\d+', s)[0] if re.findall(r'\d+', s) else IN[1] + '_' + s for s in IN[0]]
# ----------------------------------------
current = Autodesk.AutoCAD.DynamoNodes.Document.Current()
modelSpace = Autodesk.AutoCAD.DynamoNodes.Document.ModelSpace(document=current)
byGeometry = Autodesk.AutoCAD.DynamoNodes.Object.ByGeometry(geometry=thicken, layer=layer_names, block=modelSpace)

# group: Evaluation Dictionaries
filter_evaluation = Python(IN[0]=importExcel_4, IN[1]=Vannstand)
# ---------- filter_evaluation.python (1 lines) ----------
OUT = [i for i in IN[0][1:] if IN[1] in i[1]]
# ----------------------------------------
python_script = Python(IN[0]=filter_evaluation)
# ---------- python_script.python (3 lines) ----------
keys = ("Sikkerhet_mot", "Vannstand", "Name", "Sikkerhetsfaktor", "Sikkerhetskrav", "Stabilitet")

OUT = [dict(zip(keys, i)) for i in IN[0]]
# ----------------------------------------

# group: Add Property Set
code_block_6 = CodeBlock { "Egenskaper"; }
python_script_2 = Python(IN[0]=code_block_4.out0, IN[1]=code_block_4.out1, IN[2]=code_block_4.out2, IN[3]=load, IN[4]=getItemAtIndex, IN[5]=code_block_5, IN[6]=Vannstand)
# ---------- python_script_2.python (20 lines) ----------
levels = ('HRV + is', 'DFV', 'MFV')
level = ''
for l in levels:
	if IN[6] in l:
		level = l
		break

dics = []
for name, weight, width, load, axis, vol in zip(
	IN[0], IN[1], IN[2], IN[3], IN[4], IN[5]
	):
	dics.append({'Name': name,
				 'Axis': axis,
				 'Specific_weight': weight,
				 'Load': load,
				 'Width': width,
				 'Volume': vol,
				 'Vannstand': level})
	
OUT = dics
# ----------------------------------------
python_script_3 = Python(IN[0]=byGeometry, IN[1]=code_block_6, IN[2]=python_script_2)
# ---------- python_script_3.python (10 lines) ----------
objects = IN[0]
pset = IN[1]
dics = IN[2]

for (obj, dic) in zip(objects, dics):
	obj.AddPropertySet(pset)
	for key in dic.keys():
		obj.UpdateProperty(pset, key, str(dic[key]))
	
OUT = objects
# ----------------------------------------
code_block_7 = CodeBlock { "Stabilitet"; }
python_script_4 = Python(IN[0]=byGeometry, IN[1]=code_block_7, IN[2]=python_script)
# ---------- python_script_4.python (16 lines) ----------
objects = IN[0]
pset = IN[1]
dicts = IN[2]

for obj in objects:
	layer = obj.Layer
	if "Pilar" in layer:
		number = layer.split("_")[-1]
		
		for dic in dicts:
			if dic['Name'] == number:
				obj.AddPropertySet(pset)
				for key in dic.keys():
					obj.UpdateProperty(pset, key, str(dic[key]))
	
OUT = objects
# ----------------------------------------
execution_order = Python(IN[0]=python_script_3, IN[1]=python_script_4)
# ---------- execution_order.python (1 lines) ----------
OUT = IN[0]
# ----------------------------------------

# group: Set Colours
colour_dictionary = Python(IN[0]=Vannstand)
# ---------- colour_dictionary.python (14 lines) ----------
#import sys
import clr

clr.AddReference('DSCoreNodes')
from DSCore import Color


color_dic = {IN[0] + '_Opptrykk': Color.ByARGB(255, 255, 204, 255),
			 IN[0] + '_Vanntrykk': Color.ByARGB(255, 178, 102, 255),
			 IN[0] + '_Vannvekt': Color.ByARGB(255, 0, 0, 204),
			 IN[0] + '_Overtopping': Color.ByARGB(255, 0, 0, 102),
			 IN[0] + '_Islast': Color.ByARGB(255, 255, 255, 255)}

OUT = color_dic
# ----------------------------------------
layer = Autodesk.AutoCAD.DynamoNodes.Object.Layer(object=execution_order)
select_object_color = Python(IN[0]=colour_dictionary, IN[1]=layer, IN[2]=python_script)
# ---------- select_object_color.python (28 lines) ----------
#import sys
import clr

#clr.AddReference('ProtoGeometry')
#from Autodesk.DesignScript.Geometry import *

clr.AddReference('DSCoreNodes')
from DSCore import Color

col_dict = IN[0]
layers = IN[1]
dicts = IN[2]

col_list = []

for layer in layers:
	if layer in col_dict.keys():
		col_list.append(col_dict[layer])
	else:
		col = Color.ByARGB(255, 96, 96, 96)
		
		layer_short = layer.split('_')[-1]
		for d in dicts:
			if d['Name'] == layer_short and d['Stabilitet'] == 'ikke ok':
				col = Color.ByARGB(255, 255, 17, 0)
		col_list.append(col)
		
OUT = col_list
# ----------------------------------------
setColor = Autodesk.AutoCAD.DynamoNodes.Object.SetColor(object=execution_order, color=select_object_color)

# group: Create Property Set Definitions by JSON
# note: INPUT
# [0] jsonpath: string
# OUTPUT
# [0] Result
# REMARKS
# PropertySets with formulas may require further manual adjustment.
python_script_5 = Python(IN[0]=EgenskaperDir)
# ---------- python_script_5.python (29 lines) ----------
"""
Copyright 2020 Autodesk, Inc. All rights reserved.

This file is part of the Civil 3D Python Module.

"""

# Add standard Python references
import sys
import os

# specify the folder that contains pset_utils.py
WORK_FOLDER = r'C:\ProgramData\Autodesk\C3D 2021\Dynamo\samples\Data\AutoCAD'

if len(WORK_FOLDER) > 0 and os.path.exists(WORK_FOLDER):
    sys.path.append(WORK_FOLDER)

from pset.pset_utils import create_ps_definitions_json as fn

jsonpath = IN[0]

if jsonpath is None:
    OUT = fn.__doc__
else:
    if not os.path.exists(jsonpath):
        raise Exception('The provided path is not valid')

    fn(jsonpath)
    OUT = True
# ----------------------------------------

# group: Create Property Set Definitions by JSON
# note: INPUT
# [0] jsonpath: string
# OUTPUT
# [0] Result
# REMARKS
# PropertySets with formulas may require further manual adjustment.
python_script_6 = Python(IN[0]=StabilitetDir)  # same code as python_script_5
